% Requirement links of Tractive_Motor_Ring_Single_Motor.slx (R2020a)

block :234 implements TMR_Single_Motor_Requirements.slreqx#1: Derating Factor
block :300 implements TMR_Single_Motor_Requirements.slreqx#4: Inverter cold plate temperature
block :301 implements TMR_Single_Motor_Requirements.slreqx#4: Inverter cold plate temperature
block :302 implements TMR_Single_Motor_Requirements.slreqx#4: Inverter cold plate temperature
block :303 implements TMR_Single_Motor_Requirements.slreqx#4: Inverter cold plate temperature
block :324 implements TMR_Single_Motor_Requirements.slreqx#2: Motor temperature
block :325 implements TMR_Single_Motor_Requirements.slreqx#11: Motor current overload derating factor
block :326 implements TMR_Single_Motor_Requirements.slreqx#11: Motor current overload derating factor
block :327 implements TMR_Single_Motor_Requirements.slreqx#11: Motor current overload derating factor
block :328 implements TMR_Single_Motor_Requirements.slreqx#11: Motor current overload derating factor